# Dynamo graph ReadPDFExample.dyn (Dynamo 1.2.1.2802)

code_block = CodeBlock { "C:\Users\MThumfart\Documents\GitHub\Grevit\DynamoPDF\Annotations.pdf"; }
code_block_2 = CodeBlock { 1000; }
getGeometries = DynamoPDF.Parser.GetGeometries(code_block, code_block_2)
