# Dynamo graph AddAnnotationsToPDF.dyn (Dynamo 1.2.1.3083)

# group: Paths
file_path = Filename("C:\Users\MThumfart\Documents\GitHub\DynamoPDF\Testfiles\Document1.pdf")
code_block = CodeBlock { ""; }

# group: Attributes
code_block_2 = CodeBlock { "Hello"; "me"; "message"; }
blue = DynamoPDF.Content.Colors.Blue()

# group: Geometry
code_block_3 = CodeBlock { 50; }
byCoordinates = Point.ByCoordinates(x=code_block_3, y=code_block_3)
byCenterPointRadius = Circle.ByCenterPointRadius(centerPoint=byCoordinates, radius=code_block_3)
regularPolygon = Polygon.RegularPolygon(circle=byCenterPointRadius)

# group: Annotation
annotation = DynamoPDF.Content.Annotation.Annotation(code_block_2.out0, code_block_2.out1, code_block_2.out2, regularPolygon, blue)
create = List.Create(annotation)

addAnnotationsToPDF = DynamoPDF.Write.AddAnnotationsToPDF(file_path, code_block, create)
