# Dynamo graph FullPageDemo.dyn (Dynamo 1.2.1.3083)

code_block = CodeBlock { ""; }
code_block_2 = CodeBlock { "Lorem ipsum dolor sit amet"; }
code_block_3 = CodeBlock { 24; }
black = DynamoPDF.Content.Colors.Black()
code_block_4 = CodeBlock { 20; }
code_block_5 = CodeBlock { "Bold"; }
font = DynamoPDF.Content.Font.Font(black, arg2=code_block_4, arg3=code_block_5)
phrase = DynamoPDF.Content.Phrase.Phrase(code_block_2, code_block_3, font)
paragraph = DynamoPDF.Content.Paragraph.Paragraph(phrase)
code_block_6 = CodeBlock()
# ---------- code_block_6.designscript (1 lines) ----------
"consetetur sadipscing elitr, sed diam nonumy eirmod tempor invidunt ut labore et dolore magna aliquyam erat, sed diam voluptua. At vero eos et accusam et justo duo dolores et ea rebum. Stet clita kasd gubergren, no sea takimata sanctus est Lorem ipsum dolor sit amet. Lorem ipsum dolor sit amet, consetetur sadipscing elitr, sed diam nonumy eirmod tempor invidunt ut labore et dolore magna aliquyam erat, sed diam voluptua. At vero eos et accusam et justo duo dolores et ea rebum. Stet clita kasd gubergren, no sea takimata sanctus est Lorem ipsum dolor sit amet.";
# ----------------------------------------
code_block_7 = CodeBlock { 14; }
code_block_8 = CodeBlock { 12; }
font_2 = DynamoPDF.Content.Font.Font(black, arg2=code_block_8)
phrase_2 = DynamoPDF.Content.Phrase.Phrase(code_block_6, code_block_7, font_2)
code_block_9 = CodeBlock { 295; }
byCoordinates = Point.ByCoordinates(x=code_block_9, y=code_block_9)
code_block_10 = CodeBlock { 200; }
byCenterPointRadius = Circle.ByCenterPointRadius(centerPoint=byCoordinates, radius=code_block_10)
code_block_11 = CodeBlock { 160; }
byCenterPointRadius_2 = Circle.ByCenterPointRadius(centerPoint=byCoordinates, radius=code_block_11)
code_block_12 = CodeBlock { 150; }
byCenterPointRadius_3 = Circle.ByCenterPointRadius(centerPoint=byCoordinates, radius=code_block_12)
create = List.Create(byCenterPointRadius, byCenterPointRadius_2, byCenterPointRadius_3)
code_block_13 = CodeBlock { 2.0; }
printStroke = DynamoPDF.Geometries.PrintSettings.PrintStroke(code_block_13, black)
PDFGeometry = DynamoPDF.Geometries.PDFGeometry.PDFGeometry(create, printStroke)
code_block_14 = CodeBlock { 265; }
byCoordinates_2 = Point.ByCoordinates(x=code_block_9, y=code_block_14)
byStartPointEndPoint = Line.ByStartPointEndPoint(startPoint=byCoordinates, endPoint=byCoordinates_2)
code_block_15 = CodeBlock { 0..225..5; }
translate = Geometry.Translate(geometry=byStartPointEndPoint, xTranslation=code_block_15)
byOriginNormal = Plane.ByOriginNormal(origin=byCoordinates_2)
code_block_16 = CodeBlock { 0..450..10; }
rotate = Geometry.Rotate(translate, byOriginNormal, code_block_16)
extendEnd = Curve.ExtendEnd(curve=rotate, distance=code_block_15)
code_block_17 = CodeBlock { 1.0; }
printStroke_2 = DynamoPDF.Geometries.PrintSettings.PrintStroke(code_block_17, black)
PDFGeometry_2 = DynamoPDF.Geometries.PDFGeometry.PDFGeometry(extendEnd, printStroke_2)
create_2 = List.Create(paragraph, phrase_2, PDFGeometry, PDFGeometry_2)
flatten = Flatten(create_2)
code_block_18 = CodeBlock { "A4"; }
white = DynamoPDF.Content.Colors.White()
pageBySize = DynamoPDF.Content.Page.PageBySize(code_block_18, white)
code_block_19 = CodeBlock { 25; }
createNewPDF = DynamoPDF.Write.CreateNewPDF(code_block, flatten, pageBySize, code_block_19, code_block_19, code_block_19, code_block_19)
