# Dynamo graph ReadPDF.dyn (Dynamo 1.2.1.3083)

# group: Select PDF
file_path = Filename("C:\Users\MThumfart\Documents\GitHub\DynamoPDF\Testfiles\Document1.pdf")

# group: Get Text
getPDFPageAsText = DynamoPDF.Read.GetPDFPageAsText(file_path)
watch = Watch(getPDFPageAsText)
getEntirePDFAsText = DynamoPDF.Read.GetEntirePDFAsText(file_path)
watch_2 = Watch(getEntirePDFAsText)

getAnnotationsFromPDF = DynamoPDF.Read.GetAnnotationsFromPDF(file_path)

# group: Properties
getSubject = DynamoPDF.Content.Annotation.GetSubject(getAnnotationsFromPDF)
watch_3 = Watch(getSubject)
getGeometry = DynamoPDF.Content.Annotation.GetGeometry(getAnnotationsFromPDF)
getColor = DynamoPDF.Content.Annotation.GetColor(getAnnotationsFromPDF)
byGeometryColor = Display.Display.ByGeometryColor(getGeometry, getColor)
getCreated = DynamoPDF.Content.Annotation.GetCreated(getAnnotationsFromPDF)
watch_4 = Watch(getCreated)
