# Dynamo graph WritePDF.dyn (Dynamo 1.2.1.3083)

# group: Filepath
code_block = CodeBlock { ""; }

# group: Geometry
code_block_2 = CodeBlock { 190; }
byCoordinates = Point.ByCoordinates(x=code_block_2, y=code_block_2)
byCenterPointRadius = Circle.ByCenterPointRadius(centerPoint=byCoordinates, radius=code_block_2)

# group: Print Settings
code_block_3 = CodeBlock { 2.5; }
blue = DynamoPDF.Content.Colors.Blue()
printStroke = DynamoPDF.Geometries.PrintSettings.PrintStroke(code_block_3, blue)

PDFGeometry = DynamoPDF.Geometries.PDFGeometry.PDFGeometry(byCenterPointRadius, printStroke)

# group: Font
black = DynamoPDF.Content.Colors.Black()
code_block_4 = CodeBlock { 15; }
font = DynamoPDF.Content.Font.Font(black, arg2=code_block_4)

# group: Paragraph
code_block_5 = CodeBlock { "Hello World"; }
code_block_6 = CodeBlock { 2.0; }
phrase = DynamoPDF.Content.Phrase.Phrase(code_block_5, code_block_6, font)
paragraph = DynamoPDF.Content.Paragraph.Paragraph(phrase)

# group: Assemble Contents
pageBreak = DynamoPDF.Content.PageBreak.PageBreak()
create = List.Create(PDFGeometry, pageBreak, paragraph)

# group: Page Setup
code_block_7 = CodeBlock { "A4"; }
white = DynamoPDF.Content.Colors.White()
pageBySize = DynamoPDF.Content.Page.PageBySize(code_block_7, white)

createNewPDF = DynamoPDF.Write.CreateNewPDF(code_block, create, pageBySize)
